# Grasshopper definition Flag-Wind.ghx (Grasshopper 0.9.76)
# plug-ins: Kangaroo2 Components

mplane = MeshPlane(Boundary={Plane=PlaneXZ(5, 0, 5), Size=Domain2(u=0..15, v=0..10)}, WidthCount=15, HeightCount=10)  # -> Mesh, Area
pt = Point([Point(5, 0, 15), Point(5, 0, 5)])
vec = Vector(Vector(19, 17, 0))
item = ListItem(List=pt, Index="0", Wrap=True)  # -> Item, Item1
multiplication = Multiplication(A=vec, B=Slider(0.045, range=0..1))
tri = Triangulate(Mesh=mplane.Mesh)  # -> Mesh, Count
anchor = Anchor(Point=pt, Strength=10000)
devec = DeconstructVector(Vector=item.Item1)  # -> XComponent, YComponent, ZComponent
pt_2 = ConstructPoint(XCoordinate=devec.XComponent, YCoordinate=devec.YComponent, ZCoordinate="0")
show = Show(G=mplane.Mesh)
ln = Line(StartPoint=item.Item, EndPoint=pt_2)
medges = MeshEdges(Mesh=tri.Mesh)  # -> NakedEdges, InteriorEdges, NonManifoldEdges
wind = Wind(Mesh=tri.Mesh, WindVector=multiplication)
smooth = Smooth(M=tri.Mesh, Strength=1)
length_line = LengthLine(Line=[medges.NakedEdges, medges.InteriorEdges], Strength=10)
bouncysolver = BouncySolver(
    GoalObjects=[length_line, show, anchor, wind, smooth],
    Reset=False,
    Threshold=1e-15,
    Tolerance=0.01,
    Damping=0.99,
    Iterations=2,
    On=True)  # -> I, V, O
panel = Panel(bouncysolver.I)
data = Data(bouncysolver.O)
panel_2 = Panel(bouncysolver.V)
panel_3 = Panel(data)
